# Dynamo graph CC_Moss_Pantallas_Roca_wall_ARD_Prueba_definitiva2021.dyn (Dynamo 2.3.0.5885)
# packages: LunchBox for Dynamo 2018.7.7, spring nodes 203.1.0

# group: Select Line
select_model_element = DSModelElementSelection()  # 1 picked in the model

geometry = Element.Geometry(element=select_model_element)

# group: Data
longitud_de_batache_m = CodeBlock { 6.4; }
ancho_de_batache_m = CodeBlock { 1.2; }
medida_de_las_cuchillas_de = CodeBlock { 2.8; }  # "Medida de las cuchillas de excavación (m)"

divideCurveByDistance = Geometry.Curves.DivideCurveByDistance(curve=geometry, Distance=longitud_de_batache_m)
byStartPointDirectionLength = Line.ByStartPointDirectionLength(startPoint=divideCurveByDistance.Points, direction=divideCurveByDistance.Tangents, length=longitud_de_batache_m)
flatten = List.Flatten(list=byStartPointDirectionLength)
endPoints = Geometry.Curves.EndPoints(curve=byStartPointDirectionLength)
ZAxis = Vector.ZAxis()
code_block = CodeBlock { -100; }
byStartPointDirectionLength_2 = Line.ByStartPointDirectionLength(startPoint=endPoints.StartPoint, direction=ZAxis, length=code_block)

# group: Select Topography
select_model_element_2 = DSModelElementSelection()  # nothing selected

mesh = Topography.Mesh(topography=select_model_element_2)
ꟿ_mesh_topolysurface = Custom[ꟿ Mesh.ToPolySurface](mesh=mesh)  # package spring nodes; Converts a Dynamo mesh to a polysurface. By default the node is single threaded, but if you specify a higher number of threads in the `NUMTHREAD` input, the node will run multi-threaded to speed up the conversion. *WARNING* Using multi-threaded code with Dynamo's geometry kernel may crash Revit in some cases.
intersectAll = Geometry.IntersectAll(geometry=byStartPointDirectionLength_2, others=ꟿ_mesh_topolysurface)
deconstructPoint = Geometry.Points.DeconstructPoint(point=intersectAll)
byStartPointDirectionLength_3 = Line.ByStartPointDirectionLength(startPoint=endPoints.EndPoint, direction=ZAxis, length=code_block)
intersectAll_2 = Geometry.IntersectAll(geometry=byStartPointDirectionLength_3, others=ꟿ_mesh_topolysurface)
deconstructPoint_2 = Geometry.Points.DeconstructPoint(point=intersectAll_2)
gt = deconstructPoint.Z > deconstructPoint_2.Z
flatten_2 = List.Flatten(list=gt)
filterByBoolMask = List.FilterByBoolMask(list=flatten, mask=flatten_2)
list_create = List.Create(item0=filterByBoolMask.in)
flatten_3 = List.Flatten(list=list_create)
code_block_2 = CodeBlock { 2; }
div = ancho_de_batache_m / code_block_2
code_block_3 = CodeBlock { -1; }
mul = div * code_block_3
offset = Curve.Offset(curve=filterByBoolMask.in, distance=mul)
offset_2 = Curve.Offset(curve=filterByBoolMask.in, distance=div)
list_create_2 = List.Create(item0=flatten_3, item1=offset, item2=offset_2)
transpose = List.Transpose(lists=list_create_2)
code_block_4 = CodeBlock { 5; }
mul_2 = longitud_de_batache_m * code_block_4
divideCurve = Geometry.Curves.DivideCurve(curve=transpose, Number=mul_2)
code_block_5 = CodeBlock { [0,9,18,32]; }
getItemAtIndex = List.GetItemAtIndex(list=divideCurve.Points@@L2, index=code_block_5)
code_block_6 = CodeBlock { [0,1]; }
getItemAtIndex_2 = List.GetItemAtIndex(list=getItemAtIndex@@L2, index=code_block_6)
code_block_7 = CodeBlock { 1; }
getItemAtIndex_3 = List.GetItemAtIndex(list=getItemAtIndex_2@L3, index=code_block_7)
getItemAtIndex_4 = List.GetItemAtIndex(list=getItemAtIndex_3@L2, index=code_block_7)
code_block_8 = CodeBlock { 1; }
getItemAtIndex_5 = List.GetItemAtIndex(list=getItemAtIndex_3@L2, index=code_block_8)
code_block_9 = CodeBlock { [1,2]; }
getItemAtIndex_6 = List.GetItemAtIndex(list=getItemAtIndex@@L2, index=code_block_9)
code_block_10 = CodeBlock { 1; }
getItemAtIndex_7 = List.GetItemAtIndex(list=getItemAtIndex_6@L3, index=code_block_10)
getItemAtIndex_8 = List.GetItemAtIndex(list=getItemAtIndex_7@L2, index=code_block_10)
code_block_11 = CodeBlock { 1; }
getItemAtIndex_9 = List.GetItemAtIndex(list=getItemAtIndex_7@L2, index=code_block_11)
code_block_12 = CodeBlock { [2,3]; }
getItemAtIndex_10 = List.GetItemAtIndex(list=getItemAtIndex@@L2, index=code_block_12)
code_block_13 = CodeBlock { 1; }
getItemAtIndex_11 = List.GetItemAtIndex(list=getItemAtIndex_10@L3, index=code_block_13)
getItemAtIndex_12 = List.GetItemAtIndex(list=getItemAtIndex_11@L2, index=code_block_13)
code_block_14 = CodeBlock { 1; }
getItemAtIndex_13 = List.GetItemAtIndex(list=getItemAtIndex_11@L2, index=code_block_14)
code_block_15 = CodeBlock { 2; }
getItemAtIndex_14 = List.GetItemAtIndex(list=getItemAtIndex_2@L3, index=code_block_15)
getItemAtIndex_15 = List.GetItemAtIndex(list=getItemAtIndex_14@L2, index=code_block_15)
code_block_16 = CodeBlock { 1; }
getItemAtIndex_16 = List.GetItemAtIndex(list=getItemAtIndex_14@L2, index=code_block_16)
code_block_17 = CodeBlock { 2; }
getItemAtIndex_17 = List.GetItemAtIndex(list=getItemAtIndex_6@L3, index=code_block_17)
getItemAtIndex_18 = List.GetItemAtIndex(list=getItemAtIndex_17@L2, index=code_block_17)
code_block_18 = CodeBlock { 1; }
getItemAtIndex_19 = List.GetItemAtIndex(list=getItemAtIndex_17@L2, index=code_block_18)
code_block_19 = CodeBlock { 2; }
getItemAtIndex_20 = List.GetItemAtIndex(list=getItemAtIndex_10@L3, index=code_block_19)
getItemAtIndex_21 = List.GetItemAtIndex(list=getItemAtIndex_20@L2, index=code_block_19)
code_block_20 = CodeBlock { 1; }
getItemAtIndex_22 = List.GetItemAtIndex(list=getItemAtIndex_20@L2, index=code_block_20)
list_create_3 = List.Create(item0=filterByBoolMask.out)
flatten_4 = List.Flatten(list=list_create_3)
code_block_21 = CodeBlock { -0.6; }
offset_3 = Curve.Offset(curve=filterByBoolMask.out, distance=code_block_21)
code_block_22 = CodeBlock { 0.6; }
offset_4 = Curve.Offset(curve=filterByBoolMask.out, distance=code_block_22)
list_create_4 = List.Create(item0=flatten_4, item1=offset_3, item2=offset_4)
transpose_2 = List.Transpose(lists=list_create_4)
divideCurve_2 = Geometry.Curves.DivideCurve(curve=transpose_2, Number=mul_2)
code_block_23 = CodeBlock { [0,14,23,32]; }
getItemAtIndex_23 = List.GetItemAtIndex(list=divideCurve_2.Points@@L2, index=code_block_23)
code_block_24 = CodeBlock { [0,1]; }
getItemAtIndex_24 = List.GetItemAtIndex(list=getItemAtIndex_23@@L2, index=code_block_24)
code_block_25 = CodeBlock { 1; }
getItemAtIndex_25 = List.GetItemAtIndex(list=getItemAtIndex_24@L3, index=code_block_25)
getItemAtIndex_26 = List.GetItemAtIndex(list=getItemAtIndex_25@L2, index=code_block_25)
code_block_26 = CodeBlock { 1; }
getItemAtIndex_27 = List.GetItemAtIndex(list=getItemAtIndex_25@L2, index=code_block_26)
code_block_27 = CodeBlock { [1,2]; }
getItemAtIndex_28 = List.GetItemAtIndex(list=getItemAtIndex_23@@L2, index=code_block_27)
code_block_28 = CodeBlock { 1; }
getItemAtIndex_29 = List.GetItemAtIndex(list=getItemAtIndex_28@L3, index=code_block_28)
getItemAtIndex_30 = List.GetItemAtIndex(list=getItemAtIndex_29@L2, index=code_block_28)
code_block_29 = CodeBlock { 1; }
getItemAtIndex_31 = List.GetItemAtIndex(list=getItemAtIndex_29@L2, index=code_block_29)
code_block_30 = CodeBlock { [2,3]; }
getItemAtIndex_32 = List.GetItemAtIndex(list=getItemAtIndex_23@@L2, index=code_block_30)
code_block_31 = CodeBlock { 1; }
getItemAtIndex_33 = List.GetItemAtIndex(list=getItemAtIndex_32@L3, index=code_block_31)
getItemAtIndex_34 = List.GetItemAtIndex(list=getItemAtIndex_33@L2, index=code_block_31)
code_block_32 = CodeBlock { 1; }
getItemAtIndex_35 = List.GetItemAtIndex(list=getItemAtIndex_33@L2, index=code_block_32)
code_block_33 = CodeBlock { 2; }
getItemAtIndex_36 = List.GetItemAtIndex(list=getItemAtIndex_24@L3, index=code_block_33)
getItemAtIndex_37 = List.GetItemAtIndex(list=getItemAtIndex_36@L2, index=code_block_33)
code_block_34 = CodeBlock { 1; }
getItemAtIndex_38 = List.GetItemAtIndex(list=getItemAtIndex_36@L2, index=code_block_34)
code_block_35 = CodeBlock { 2; }
getItemAtIndex_39 = List.GetItemAtIndex(list=getItemAtIndex_28@L3, index=code_block_35)
getItemAtIndex_40 = List.GetItemAtIndex(list=getItemAtIndex_39@L2, index=code_block_35)
code_block_36 = CodeBlock { 1; }
getItemAtIndex_41 = List.GetItemAtIndex(list=getItemAtIndex_39@L2, index=code_block_36)
code_block_37 = CodeBlock { 2; }
getItemAtIndex_42 = List.GetItemAtIndex(list=getItemAtIndex_32@L3, index=code_block_37)
getItemAtIndex_43 = List.GetItemAtIndex(list=getItemAtIndex_42@L2, index=code_block_37)
code_block_38 = CodeBlock { 1; }
getItemAtIndex_44 = List.GetItemAtIndex(list=getItemAtIndex_42@L2, index=code_block_38)
normalizeDepth = List.NormalizeDepth(list=getItemAtIndex_28@L3)
ZAxis_2 = Vector.ZAxis()
reverse = Vector.Reverse(vector=ZAxis_2)
project = Point.Project(point=normalizeDepth, baseGeometry=ꟿ_mesh_topolysurface, projectionDirection=reverse, lacing=CrossProduct)
code_block_39 = CodeBlock { [0,1]; }
removeItemAtIndex = List.RemoveItemAtIndex(list=project@L3, indices=code_block_39)
normalizeDepth_2 = List.NormalizeDepth(list=getItemAtIndex_32@L3)
project_2 = Point.Project(point=normalizeDepth_2, baseGeometry=ꟿ_mesh_topolysurface, projectionDirection=reverse, lacing=CrossProduct)
code_block_40 = CodeBlock { [0,1]; }
removeItemAtIndex_2 = List.RemoveItemAtIndex(list=project_2@L3, indices=code_block_40)
code_block_41 = CodeBlock { 0; }
getItemAtIndex_45 = List.GetItemAtIndex(list=getItemAtIndex_2@L3, index=code_block_41)
getItemAtIndex_46 = List.GetItemAtIndex(list=getItemAtIndex_45@L2, index=code_block_41)
deconstructPoint_3 = Geometry.Points.DeconstructPoint(point=getItemAtIndex_46)
normalizeDepth_3 = List.NormalizeDepth(list=getItemAtIndex_2@L3)
ZAxis_3 = Vector.ZAxis()
reverse_2 = Vector.Reverse(vector=ZAxis_3)
project_3 = Point.Project(point=normalizeDepth_3, baseGeometry=ꟿ_mesh_topolysurface, projectionDirection=reverse_2, lacing=CrossProduct)
normalizeDepth_4 = List.NormalizeDepth(list=project_3@L3)
deconstructPoint_4 = Geometry.Points.DeconstructPoint(point=normalizeDepth_4)
maximumItem = List.MaximumItem(list=deconstructPoint_4.Z@L3)
byCoordinates = Point.ByCoordinates(x=deconstructPoint_3.X@L2, y=deconstructPoint_3.Y@L2, z=maximumItem@L2)
code_block_42 = CodeBlock { 1; }
getItemAtIndex_47 = List.GetItemAtIndex(list=getItemAtIndex_45@L2, index=code_block_42)
deconstructPoint_5 = Geometry.Points.DeconstructPoint(point=getItemAtIndex_47)
byCoordinates_2 = Point.ByCoordinates(x=deconstructPoint_5.X@L2, y=deconstructPoint_5.Y@L2, z=maximumItem@L2)
code_block_43 = CodeBlock { 0; }
getItemAtIndex_48 = List.GetItemAtIndex(list=getItemAtIndex_6@L3, index=code_block_43)
getItemAtIndex_49 = List.GetItemAtIndex(list=getItemAtIndex_48@L2, index=code_block_43)
deconstructPoint_6 = Geometry.Points.DeconstructPoint(point=getItemAtIndex_49)
normalizeDepth_5 = List.NormalizeDepth(list=getItemAtIndex_6@L3)
project_4 = Point.Project(point=normalizeDepth_5, baseGeometry=ꟿ_mesh_topolysurface, projectionDirection=reverse_2, lacing=CrossProduct)
normalizeDepth_6 = List.NormalizeDepth(list=project_4@L3)
deconstructPoint_7 = Geometry.Points.DeconstructPoint(point=normalizeDepth_6)
maximumItem_2 = List.MaximumItem(list=deconstructPoint_7.Z@L3)
byCoordinates_3 = Point.ByCoordinates(x=deconstructPoint_6.X@L2, y=deconstructPoint_6.Y@L2, z=maximumItem_2@L2)
code_block_44 = CodeBlock { 1; }
getItemAtIndex_50 = List.GetItemAtIndex(list=getItemAtIndex_48@L2, index=code_block_44)
deconstructPoint_8 = Geometry.Points.DeconstructPoint(point=getItemAtIndex_50)
byCoordinates_4 = Point.ByCoordinates(x=deconstructPoint_8.X@L2, y=deconstructPoint_8.Y@L2, z=maximumItem_2@L2)
code_block_45 = CodeBlock { 0; }
getItemAtIndex_51 = List.GetItemAtIndex(list=getItemAtIndex_10@L3, index=code_block_45)
getItemAtIndex_52 = List.GetItemAtIndex(list=getItemAtIndex_51@L2, index=code_block_45)
deconstructPoint_9 = Geometry.Points.DeconstructPoint(point=getItemAtIndex_52)
normalizeDepth_7 = List.NormalizeDepth(list=getItemAtIndex_10@L3)
project_5 = Point.Project(point=normalizeDepth_7, baseGeometry=ꟿ_mesh_topolysurface, projectionDirection=reverse_2, lacing=CrossProduct)
normalizeDepth_8 = List.NormalizeDepth(list=project_5@L3)
deconstructPoint_10 = Geometry.Points.DeconstructPoint(point=normalizeDepth_8)
maximumItem_3 = List.MaximumItem(list=deconstructPoint_10.Z@L3)
byCoordinates_5 = Point.ByCoordinates(x=deconstructPoint_9.X@L2, y=deconstructPoint_9.Y@L2, z=maximumItem_3@L2)
code_block_46 = CodeBlock { 1; }
getItemAtIndex_53 = List.GetItemAtIndex(list=getItemAtIndex_51@L2, index=code_block_46)
deconstructPoint_11 = Geometry.Points.DeconstructPoint(point=getItemAtIndex_53)
byCoordinates_6 = Point.ByCoordinates(x=deconstructPoint_11.X@L2, y=deconstructPoint_11.Y@L2, z=maximumItem_3@L2)
endPoints_2 = Geometry.Curves.EndPoints(curve=filterByBoolMask.in)
list_create_5 = List.Create(item0=endPoints_2.EndPoint)
list_create_6 = List.Create(item0=endPoints_2.StartPoint)
list_create_7 = List.Create(item0=byCoordinates, item1=byCoordinates_2, item2=byCoordinates_3, item3=byCoordinates_4, item4=byCoordinates_5, item5=byCoordinates_6, item6=list_create_5, item7=list_create_6)
code_block_47 = CodeBlock { 1; }
flatten_5 = List.Flatten(list=list_create_7, amt=code_block_47)
transpose_3 = List.Transpose(lists=flatten_5)
family_types = FamilyTypes("GEN-GEN-Diaphragm_Wall_Adaptative_2:GEN-Diaphragm_Wall_1200mm")
byPoints = AdaptiveComponent.ByPoints(points=transpose_3, familyType=family_types)
code_block_48 = CodeBlock { "DW_1_a_x"; "DW_1_b_x"; "DW_1_c_x"; "DW_1_d_x"; }
code_block_49 = CodeBlock { [0,1]; }
removeItemAtIndex_3 = List.RemoveItemAtIndex(list=project_3@L3, indices=code_block_49)
deconstructPoint_12 = Geometry.Points.DeconstructPoint(point=removeItemAtIndex_3)
x = CodeBlock { 109023.0280; }
add = deconstructPoint_12.X + x
code_block_50 = CodeBlock { 0; 1; 2; 3; }
getItemAtIndex_54 = List.GetItemAtIndex(list=add@L3, index=code_block_50.out0)
setParameterByName = Element.SetParameterByName(element=byPoints, parameterName=code_block_48.out0, value=getItemAtIndex_54)
getItemAtIndex_55 = List.GetItemAtIndex(list=add@L3, index=code_block_50.out1)
setParameterByName_2 = Element.SetParameterByName(element=byPoints, parameterName=code_block_48.out1, value=getItemAtIndex_55)
getItemAtIndex_56 = List.GetItemAtIndex(list=add@L3, index=code_block_50.out2)
setParameterByName_3 = Element.SetParameterByName(element=byPoints, parameterName=code_block_48.out2, value=getItemAtIndex_56)
getItemAtIndex_57 = List.GetItemAtIndex(list=add@L3, index=code_block_50.out3)
setParameterByName_4 = Element.SetParameterByName(element=byPoints, parameterName=code_block_48.out3, value=getItemAtIndex_57)
code_block_51 = CodeBlock { "DW_1_a_y"; "DW_1_b_y"; "DW_1_c_y"; "DW_1_d_y"; }
y = CodeBlock { 1159409.3745; }
add_2 = deconstructPoint_12.Y + y
code_block_52 = CodeBlock { 0; 1; 2; 3; }
getItemAtIndex_58 = List.GetItemAtIndex(list=add_2@L3, index=code_block_52.out0)
setParameterByName_5 = Element.SetParameterByName(element=byPoints, parameterName=code_block_51.out0, value=getItemAtIndex_58)
getItemAtIndex_59 = List.GetItemAtIndex(list=add_2@L3, index=code_block_52.out1)
setParameterByName_6 = Element.SetParameterByName(element=byPoints, parameterName=code_block_51.out1, value=getItemAtIndex_59)
getItemAtIndex_60 = List.GetItemAtIndex(list=add_2@L3, index=code_block_52.out2)
setParameterByName_7 = Element.SetParameterByName(element=byPoints, parameterName=code_block_51.out2, value=getItemAtIndex_60)
getItemAtIndex_61 = List.GetItemAtIndex(list=add_2@L3, index=code_block_52.out3)
setParameterByName_8 = Element.SetParameterByName(element=byPoints, parameterName=code_block_51.out3, value=getItemAtIndex_61)
code_block_53 = CodeBlock { "DW_1_a_zr"; "DW_1_b_zr"; "DW_1_c_zr"; "DW_1_d_zr"; }
code_block_54 = CodeBlock { 0; 1; 2; 3; }
getItemAtIndex_62 = List.GetItemAtIndex(list=deconstructPoint_12.Z@L3, index=code_block_54.out0)
setParameterByName_9 = Element.SetParameterByName(element=byPoints, parameterName=code_block_53.out0, value=getItemAtIndex_62)
getItemAtIndex_63 = List.GetItemAtIndex(list=deconstructPoint_12.Z@L3, index=code_block_54.out1)
setParameterByName_10 = Element.SetParameterByName(element=byPoints, parameterName=code_block_53.out1, value=getItemAtIndex_63)
getItemAtIndex_64 = List.GetItemAtIndex(list=deconstructPoint_12.Z@L3, index=code_block_54.out2)
setParameterByName_11 = Element.SetParameterByName(element=byPoints, parameterName=code_block_53.out2, value=getItemAtIndex_64)
getItemAtIndex_65 = List.GetItemAtIndex(list=deconstructPoint_12.Z@L3, index=code_block_54.out3)
setParameterByName_12 = Element.SetParameterByName(element=byPoints, parameterName=code_block_53.out3, value=getItemAtIndex_65)
code_block_55 = CodeBlock { "DW_2_a_x"; "DW_2_b_x"; "DW_2_c_x"; "DW_2_d_x"; }
code_block_56 = CodeBlock { [0,1]; }
removeItemAtIndex_4 = List.RemoveItemAtIndex(list=project_4@L3, indices=code_block_56)
deconstructPoint_13 = Geometry.Points.DeconstructPoint(point=removeItemAtIndex_4)
x_2 = CodeBlock { 109023.0280; }
add_3 = deconstructPoint_13.X + x_2
code_block_57 = CodeBlock { 0; 1; 2; 3; }
getItemAtIndex_66 = List.GetItemAtIndex(list=add_3@L3, index=code_block_57.out0)
setParameterByName_13 = Element.SetParameterByName(element=byPoints, parameterName=code_block_55.out0, value=getItemAtIndex_66)
getItemAtIndex_67 = List.GetItemAtIndex(list=add_3@L3, index=code_block_57.out1)
setParameterByName_14 = Element.SetParameterByName(element=byPoints, parameterName=code_block_55.out1, value=getItemAtIndex_67)
getItemAtIndex_68 = List.GetItemAtIndex(list=add_3@L3, index=code_block_57.out2)
setParameterByName_15 = Element.SetParameterByName(element=byPoints, parameterName=code_block_55.out2, value=getItemAtIndex_68)
getItemAtIndex_69 = List.GetItemAtIndex(list=add_3@L3, index=code_block_57.out3)
setParameterByName_16 = Element.SetParameterByName(element=byPoints, parameterName=code_block_55.out3, value=getItemAtIndex_69)
code_block_58 = CodeBlock { "DW_2_a_y"; "DW_2_b_y"; "DW_2_c_y"; "DW_2_d_y"; }
y_2 = CodeBlock { 1159409.3745; }
add_4 = deconstructPoint_13.Y + y_2
code_block_59 = CodeBlock { 0; 1; 2; 3; }
getItemAtIndex_70 = List.GetItemAtIndex(list=add_4@L3, index=code_block_59.out0)
setParameterByName_17 = Element.SetParameterByName(element=byPoints, parameterName=code_block_58.out0, value=getItemAtIndex_70)
getItemAtIndex_71 = List.GetItemAtIndex(list=add_4@L3, index=code_block_59.out1)
setParameterByName_18 = Element.SetParameterByName(element=byPoints, parameterName=code_block_58.out1, value=getItemAtIndex_71)
getItemAtIndex_72 = List.GetItemAtIndex(list=add_4@L3, index=code_block_59.out2)
setParameterByName_19 = Element.SetParameterByName(element=byPoints, parameterName=code_block_58.out2, value=getItemAtIndex_72)
getItemAtIndex_73 = List.GetItemAtIndex(list=add_4@L3, index=code_block_59.out3)
setParameterByName_20 = Element.SetParameterByName(element=byPoints, parameterName=code_block_58.out3, value=getItemAtIndex_73)
code_block_60 = CodeBlock { "DW_2_a_zr"; "DW_2_b_zr"; "DW_2_c_zr"; "DW_2_d_zr"; }
code_block_61 = CodeBlock { 0; 1; 2; 3; }
getItemAtIndex_74 = List.GetItemAtIndex(list=deconstructPoint_13.Z@L3, index=code_block_61.out0)
setParameterByName_21 = Element.SetParameterByName(element=byPoints, parameterName=code_block_60.out0, value=getItemAtIndex_74)
getItemAtIndex_75 = List.GetItemAtIndex(list=deconstructPoint_13.Z@L3, index=code_block_61.out1)
setParameterByName_22 = Element.SetParameterByName(element=byPoints, parameterName=code_block_60.out1, value=getItemAtIndex_75)
getItemAtIndex_76 = List.GetItemAtIndex(list=deconstructPoint_13.Z@L3, index=code_block_61.out2)
setParameterByName_23 = Element.SetParameterByName(element=byPoints, parameterName=code_block_60.out2, value=getItemAtIndex_76)
getItemAtIndex_77 = List.GetItemAtIndex(list=deconstructPoint_13.Z@L3, index=code_block_61.out3)
setParameterByName_24 = Element.SetParameterByName(element=byPoints, parameterName=code_block_60.out3, value=getItemAtIndex_77)
code_block_62 = CodeBlock { "DW_3_a_x"; "DW_3_b_x"; "DW_3_c_x"; "DW_3_d_x"; }
code_block_63 = CodeBlock { [0,1]; }
removeItemAtIndex_5 = List.RemoveItemAtIndex(list=project_5@L3, indices=code_block_63)
deconstructPoint_14 = Geometry.Points.DeconstructPoint(point=removeItemAtIndex_5)
x_3 = CodeBlock { 109023.0280; }
add_5 = deconstructPoint_14.X + x_3
code_block_64 = CodeBlock { 0; 1; 2; 3; }
getItemAtIndex_78 = List.GetItemAtIndex(list=add_5@L3, index=code_block_64.out0)
setParameterByName_25 = Element.SetParameterByName(element=byPoints, parameterName=code_block_62.out0, value=getItemAtIndex_78)
getItemAtIndex_79 = List.GetItemAtIndex(list=add_5@L3, index=code_block_64.out1)
setParameterByName_26 = Element.SetParameterByName(element=byPoints, parameterName=code_block_62.out1, value=getItemAtIndex_79)
getItemAtIndex_80 = List.GetItemAtIndex(list=add_5@L3, index=code_block_64.out2)
setParameterByName_27 = Element.SetParameterByName(element=byPoints, parameterName=code_block_62.out2, value=getItemAtIndex_80)
getItemAtIndex_81 = List.GetItemAtIndex(list=add_5@L3, index=code_block_64.out3)
setParameterByName_28 = Element.SetParameterByName(element=byPoints, parameterName=code_block_62.out3, value=getItemAtIndex_81)
code_block_65 = CodeBlock { "DW_3_a_y"; "DW_3_b_y"; "DW_3_c_y"; "DW_3_d_y"; }
y_3 = CodeBlock { 1159409.3745; }
add_6 = deconstructPoint_14.Y + y_3
code_block_66 = CodeBlock { 0; 1; 2; 3; }
getItemAtIndex_82 = List.GetItemAtIndex(list=add_6@L3, index=code_block_66.out0)
setParameterByName_29 = Element.SetParameterByName(element=byPoints, parameterName=code_block_65.out0, value=getItemAtIndex_82)
getItemAtIndex_83 = List.GetItemAtIndex(list=add_6@L3, index=code_block_66.out1)
setParameterByName_30 = Element.SetParameterByName(element=byPoints, parameterName=code_block_65.out1, value=getItemAtIndex_83)
getItemAtIndex_84 = List.GetItemAtIndex(list=add_6@L3, index=code_block_66.out2)
setParameterByName_31 = Element.SetParameterByName(element=byPoints, parameterName=code_block_65.out2, value=getItemAtIndex_84)
getItemAtIndex_85 = List.GetItemAtIndex(list=add_6@L3, index=code_block_66.out3)
setParameterByName_32 = Element.SetParameterByName(element=byPoints, parameterName=code_block_65.out3, value=getItemAtIndex_85)
code_block_67 = CodeBlock { "DW_3_a_zr"; "DW_3_b_zr"; "DW_3_c_zr"; "DW_3_d_zr"; }
code_block_68 = CodeBlock { 0; 1; 2; 3; }
getItemAtIndex_86 = List.GetItemAtIndex(list=deconstructPoint_14.Z@L3, index=code_block_68.out0)
setParameterByName_33 = Element.SetParameterByName(element=byPoints, parameterName=code_block_67.out0, value=getItemAtIndex_86)
getItemAtIndex_87 = List.GetItemAtIndex(list=deconstructPoint_14.Z@L3, index=code_block_68.out1)
setParameterByName_34 = Element.SetParameterByName(element=byPoints, parameterName=code_block_67.out1, value=getItemAtIndex_87)
getItemAtIndex_88 = List.GetItemAtIndex(list=deconstructPoint_14.Z@L3, index=code_block_68.out2)
setParameterByName_35 = Element.SetParameterByName(element=byPoints, parameterName=code_block_67.out2, value=getItemAtIndex_88)
getItemAtIndex_89 = List.GetItemAtIndex(list=deconstructPoint_14.Z@L3, index=code_block_68.out3)
setParameterByName_36 = Element.SetParameterByName(element=byPoints, parameterName=code_block_67.out3, value=getItemAtIndex_89)
code_block_69 = CodeBlock { 0; }
getItemAtIndex_90 = List.GetItemAtIndex(list=getItemAtIndex_24@L3, index=code_block_69)
getItemAtIndex_91 = List.GetItemAtIndex(list=getItemAtIndex_90@L2, index=code_block_69)
deconstructPoint_15 = Geometry.Points.DeconstructPoint(point=getItemAtIndex_91)
normalizeDepth_9 = List.NormalizeDepth(list=getItemAtIndex_24@L3)
project_6 = Point.Project(point=normalizeDepth_9, baseGeometry=ꟿ_mesh_topolysurface, projectionDirection=reverse, lacing=CrossProduct)
normalizeDepth_10 = List.NormalizeDepth(list=project_6@L3)
deconstructPoint_16 = Geometry.Points.DeconstructPoint(point=normalizeDepth_10)
maximumItem_4 = List.MaximumItem(list=deconstructPoint_16.Z@L3)
byCoordinates_7 = Point.ByCoordinates(x=deconstructPoint_15.X@L2, y=deconstructPoint_15.Y@L2, z=maximumItem_4@L2)
code_block_70 = CodeBlock { 1; }
getItemAtIndex_92 = List.GetItemAtIndex(list=getItemAtIndex_90@L2, index=code_block_70)
deconstructPoint_17 = Geometry.Points.DeconstructPoint(point=getItemAtIndex_92)
byCoordinates_8 = Point.ByCoordinates(x=deconstructPoint_17.X@L2, y=deconstructPoint_17.Y@L2, z=maximumItem_4@L2)
code_block_71 = CodeBlock { 0; }
getItemAtIndex_93 = List.GetItemAtIndex(list=getItemAtIndex_28@L3, index=code_block_71)
getItemAtIndex_94 = List.GetItemAtIndex(list=getItemAtIndex_93@L2, index=code_block_71)
deconstructPoint_18 = Geometry.Points.DeconstructPoint(point=getItemAtIndex_94)
normalizeDepth_11 = List.NormalizeDepth(list=project@L3)
deconstructPoint_19 = Geometry.Points.DeconstructPoint(point=normalizeDepth_11)
maximumItem_5 = List.MaximumItem(list=deconstructPoint_19.Z@L3)
byCoordinates_9 = Point.ByCoordinates(x=deconstructPoint_18.X@L2, y=deconstructPoint_18.Y@L2, z=maximumItem_5@L2)
code_block_72 = CodeBlock { 1; }
getItemAtIndex_95 = List.GetItemAtIndex(list=getItemAtIndex_93@L2, index=code_block_72)
deconstructPoint_20 = Geometry.Points.DeconstructPoint(point=getItemAtIndex_95)
byCoordinates_10 = Point.ByCoordinates(x=deconstructPoint_20.X@L2, y=deconstructPoint_20.Y@L2, z=maximumItem_5@L2)
code_block_73 = CodeBlock { 0; }
getItemAtIndex_96 = List.GetItemAtIndex(list=getItemAtIndex_32@L3, index=code_block_73)
getItemAtIndex_97 = List.GetItemAtIndex(list=getItemAtIndex_96@L2, index=code_block_73)
deconstructPoint_21 = Geometry.Points.DeconstructPoint(point=getItemAtIndex_97)
normalizeDepth_12 = List.NormalizeDepth(list=project_2@L3)
deconstructPoint_22 = Geometry.Points.DeconstructPoint(point=normalizeDepth_12)
maximumItem_6 = List.MaximumItem(list=deconstructPoint_22.Z@L3)
byCoordinates_11 = Point.ByCoordinates(x=deconstructPoint_21.X@L2, y=deconstructPoint_21.Y@L2, z=maximumItem_6@L2)
code_block_74 = CodeBlock { 1; }
getItemAtIndex_98 = List.GetItemAtIndex(list=getItemAtIndex_96@L2, index=code_block_74)
deconstructPoint_23 = Geometry.Points.DeconstructPoint(point=getItemAtIndex_98)
byCoordinates_12 = Point.ByCoordinates(x=deconstructPoint_23.X@L2, y=deconstructPoint_23.Y@L2, z=maximumItem_6@L2)
endPoints_3 = Geometry.Curves.EndPoints(curve=filterByBoolMask.out)
list_create_8 = List.Create(item0=endPoints_3.EndPoint)
list_create_9 = List.Create(item0=endPoints_3.StartPoint)
list_create_10 = List.Create(item0=byCoordinates_7, item1=byCoordinates_8, item2=byCoordinates_9, item3=byCoordinates_10, item4=byCoordinates_11, item5=byCoordinates_12, item6=list_create_8, item7=list_create_9)
code_block_75 = CodeBlock { 1; }
flatten_6 = List.Flatten(list=list_create_10, amt=code_block_75)
transpose_4 = List.Transpose(lists=flatten_6)
family_types_2 = FamilyTypes("GEN-GEN-Diaphragm_Wall_Adaptative_2:GEN-Diaphragm_Wall_1200mm")
byPoints_2 = AdaptiveComponent.ByPoints(points=transpose_4, familyType=family_types_2)
code_block_76 = CodeBlock { "DW_1_a_x"; "DW_1_b_x"; "DW_1_c_x"; "DW_1_d_x"; }
code_block_77 = CodeBlock { [0,1]; }
removeItemAtIndex_6 = List.RemoveItemAtIndex(list=project_6@L3, indices=code_block_77)
deconstructPoint_24 = Geometry.Points.DeconstructPoint(point=removeItemAtIndex_6)
x_4 = CodeBlock { 109023.0280; }
add_7 = deconstructPoint_24.X + x_4
code_block_78 = CodeBlock { 0; 1; 2; 3; }
getItemAtIndex_99 = List.GetItemAtIndex(list=add_7@L3, index=code_block_78.out0)
setParameterByName_37 = Element.SetParameterByName(element=byPoints_2, parameterName=code_block_76.out0, value=getItemAtIndex_99)
getItemAtIndex_100 = List.GetItemAtIndex(list=add_7@L3, index=code_block_78.out1)
setParameterByName_38 = Element.SetParameterByName(element=byPoints_2, parameterName=code_block_76.out1, value=getItemAtIndex_100)
getItemAtIndex_101 = List.GetItemAtIndex(list=add_7@L3, index=code_block_78.out2)
setParameterByName_39 = Element.SetParameterByName(element=byPoints_2, parameterName=code_block_76.out2, value=getItemAtIndex_101)
getItemAtIndex_102 = List.GetItemAtIndex(list=add_7@L3, index=code_block_78.out3)
setParameterByName_40 = Element.SetParameterByName(element=byPoints_2, parameterName=code_block_76.out3, value=getItemAtIndex_102)
code_block_79 = CodeBlock { "DW_1_a_y"; "DW_1_b_y"; "DW_1_c_y"; "DW_1_d_y"; }
y_4 = CodeBlock { 1159409.3745; }
add_8 = deconstructPoint_24.Y + y_4
code_block_80 = CodeBlock { 0; 1; 2; 3; }
getItemAtIndex_103 = List.GetItemAtIndex(list=add_8@L3, index=code_block_80.out0)
setParameterByName_41 = Element.SetParameterByName(element=byPoints_2, parameterName=code_block_79.out0, value=getItemAtIndex_103)
getItemAtIndex_104 = List.GetItemAtIndex(list=add_8@L3, index=code_block_80.out1)
setParameterByName_42 = Element.SetParameterByName(element=byPoints_2, parameterName=code_block_79.out1, value=getItemAtIndex_104)
getItemAtIndex_105 = List.GetItemAtIndex(list=add_8@L3, index=code_block_80.out2)
setParameterByName_43 = Element.SetParameterByName(element=byPoints_2, parameterName=code_block_79.out2, value=getItemAtIndex_105)
getItemAtIndex_106 = List.GetItemAtIndex(list=add_8@L3, index=code_block_80.out3)
setParameterByName_44 = Element.SetParameterByName(element=byPoints_2, parameterName=code_block_79.out3, value=getItemAtIndex_106)
code_block_81 = CodeBlock { "DW_1_a_zr"; "DW_1_b_zr"; "DW_1_c_zr"; "DW_1_d_zr"; }
code_block_82 = CodeBlock { 0; 1; 2; 3; }
getItemAtIndex_107 = List.GetItemAtIndex(list=deconstructPoint_24.Z@L3, index=code_block_82.out0)
setParameterByName_45 = Element.SetParameterByName(element=byPoints_2, parameterName=code_block_81.out0, value=getItemAtIndex_107)
getItemAtIndex_108 = List.GetItemAtIndex(list=deconstructPoint_24.Z@L3, index=code_block_82.out1)
setParameterByName_46 = Element.SetParameterByName(element=byPoints_2, parameterName=code_block_81.out1, value=getItemAtIndex_108)
getItemAtIndex_109 = List.GetItemAtIndex(list=deconstructPoint_24.Z@L3, index=code_block_82.out2)
setParameterByName_47 = Element.SetParameterByName(element=byPoints_2, parameterName=code_block_81.out2, value=getItemAtIndex_109)
getItemAtIndex_110 = List.GetItemAtIndex(list=deconstructPoint_24.Z@L3, index=code_block_82.out3)
setParameterByName_48 = Element.SetParameterByName(element=byPoints_2, parameterName=code_block_81.out3, value=getItemAtIndex_110)
code_block_83 = CodeBlock { "DW_2_a_x"; "DW_2_b_x"; "DW_2_c_x"; "DW_2_d_x"; }
code_block_84 = CodeBlock { [0,1]; }
removeItemAtIndex_7 = List.RemoveItemAtIndex(list=project@L3, indices=code_block_84)
deconstructPoint_25 = Geometry.Points.DeconstructPoint(point=removeItemAtIndex_7)
x_5 = CodeBlock { 109023.0280; }
add_9 = deconstructPoint_25.X + x_5
code_block_85 = CodeBlock { 0; 1; 2; 3; }
getItemAtIndex_111 = List.GetItemAtIndex(list=add_9@L3, index=code_block_85.out0)
setParameterByName_49 = Element.SetParameterByName(element=byPoints_2, parameterName=code_block_83.out0, value=getItemAtIndex_111)
getItemAtIndex_112 = List.GetItemAtIndex(list=add_9@L3, index=code_block_85.out1)
setParameterByName_50 = Element.SetParameterByName(element=byPoints_2, parameterName=code_block_83.out1, value=getItemAtIndex_112)
getItemAtIndex_113 = List.GetItemAtIndex(list=add_9@L3, index=code_block_85.out2)
setParameterByName_51 = Element.SetParameterByName(element=byPoints_2, parameterName=code_block_83.out2, value=getItemAtIndex_113)
getItemAtIndex_114 = List.GetItemAtIndex(list=add_9@L3, index=code_block_85.out3)
setParameterByName_52 = Element.SetParameterByName(element=byPoints_2, parameterName=code_block_83.out3, value=getItemAtIndex_114)
code_block_86 = CodeBlock { "DW_2_a_y"; "DW_2_b_y"; "DW_2_c_y"; "DW_2_d_y"; }
y_5 = CodeBlock { 1159409.3745; }
add_10 = deconstructPoint_25.Y + y_5
code_block_87 = CodeBlock { 0; 1; 2; 3; }
getItemAtIndex_115 = List.GetItemAtIndex(list=add_10@L3, index=code_block_87.out0)
setParameterByName_53 = Element.SetParameterByName(element=byPoints_2, parameterName=code_block_86.out0, value=getItemAtIndex_115)
getItemAtIndex_116 = List.GetItemAtIndex(list=add_10@L3, index=code_block_87.out1)
setParameterByName_54 = Element.SetParameterByName(element=byPoints_2, parameterName=code_block_86.out1, value=getItemAtIndex_116)
getItemAtIndex_117 = List.GetItemAtIndex(list=add_10@L3, index=code_block_87.out2)
setParameterByName_55 = Element.SetParameterByName(element=byPoints_2, parameterName=code_block_86.out2, value=getItemAtIndex_117)
getItemAtIndex_118 = List.GetItemAtIndex(list=add_10@L3, index=code_block_87.out3)
setParameterByName_56 = Element.SetParameterByName(element=byPoints_2, parameterName=code_block_86.out3, value=getItemAtIndex_118)
code_block_88 = CodeBlock { "DW_2_a_zr"; "DW_2_b_zr"; "DW_2_c_zr"; "DW_2_d_zr"; }
code_block_89 = CodeBlock { 0; 1; 2; 3; }
getItemAtIndex_119 = List.GetItemAtIndex(list=deconstructPoint_25.Z@L3, index=code_block_89.out0)
setParameterByName_57 = Element.SetParameterByName(element=byPoints_2, parameterName=code_block_88.out0, value=getItemAtIndex_119)
getItemAtIndex_120 = List.GetItemAtIndex(list=deconstructPoint_25.Z@L3, index=code_block_89.out1)
setParameterByName_58 = Element.SetParameterByName(element=byPoints_2, parameterName=code_block_88.out1, value=getItemAtIndex_120)
getItemAtIndex_121 = List.GetItemAtIndex(list=deconstructPoint_25.Z@L3, index=code_block_89.out2)
setParameterByName_59 = Element.SetParameterByName(element=byPoints_2, parameterName=code_block_88.out2, value=getItemAtIndex_121)
getItemAtIndex_122 = List.GetItemAtIndex(list=deconstructPoint_25.Z@L3, index=code_block_89.out3)
setParameterByName_60 = Element.SetParameterByName(element=byPoints_2, parameterName=code_block_88.out3, value=getItemAtIndex_122)
code_block_90 = CodeBlock { "DW_3_a_x"; "DW_3_b_x"; "DW_3_c_x"; "DW_3_d_x"; }
code_block_91 = CodeBlock { [0,1]; }
removeItemAtIndex_8 = List.RemoveItemAtIndex(list=project_2@L3, indices=code_block_91)
deconstructPoint_26 = Geometry.Points.DeconstructPoint(point=removeItemAtIndex_8)
x_6 = CodeBlock { 109023.0280; }
add_11 = deconstructPoint_26.X + x_6
code_block_92 = CodeBlock { 0; 1; 2; 3; }
getItemAtIndex_123 = List.GetItemAtIndex(list=add_11@L3, index=code_block_92.out0)
setParameterByName_61 = Element.SetParameterByName(element=byPoints_2, parameterName=code_block_90.out0, value=getItemAtIndex_123)
getItemAtIndex_124 = List.GetItemAtIndex(list=add_11@L3, index=code_block_92.out1)
setParameterByName_62 = Element.SetParameterByName(element=byPoints_2, parameterName=code_block_90.out1, value=getItemAtIndex_124)
getItemAtIndex_125 = List.GetItemAtIndex(list=add_11@L3, index=code_block_92.out2)
setParameterByName_63 = Element.SetParameterByName(element=byPoints_2, parameterName=code_block_90.out2, value=getItemAtIndex_125)
getItemAtIndex_126 = List.GetItemAtIndex(list=add_11@L3, index=code_block_92.out3)
setParameterByName_64 = Element.SetParameterByName(element=byPoints_2, parameterName=code_block_90.out3, value=getItemAtIndex_126)
code_block_93 = CodeBlock { "DW_3_a_y"; "DW_3_b_y"; "DW_3_c_y"; "DW_3_d_y"; }
y_6 = CodeBlock { 1159409.3745; }
add_12 = deconstructPoint_26.Y + y_6
code_block_94 = CodeBlock { 0; 1; 2; 3; }
getItemAtIndex_127 = List.GetItemAtIndex(list=add_12@L3, index=code_block_94.out0)
setParameterByName_65 = Element.SetParameterByName(element=byPoints_2, parameterName=code_block_93.out0, value=getItemAtIndex_127)
getItemAtIndex_128 = List.GetItemAtIndex(list=add_12@L3, index=code_block_94.out1)
setParameterByName_66 = Element.SetParameterByName(element=byPoints_2, parameterName=code_block_93.out1, value=getItemAtIndex_128)
getItemAtIndex_129 = List.GetItemAtIndex(list=add_12@L3, index=code_block_94.out2)
setParameterByName_67 = Element.SetParameterByName(element=byPoints_2, parameterName=code_block_93.out2, value=getItemAtIndex_129)
getItemAtIndex_130 = List.GetItemAtIndex(list=add_12@L3, index=code_block_94.out3)
setParameterByName_68 = Element.SetParameterByName(element=byPoints_2, parameterName=code_block_93.out3, value=getItemAtIndex_130)
code_block_95 = CodeBlock { "DW_3_a_zr"; "DW_3_b_zr"; "DW_3_c_zr"; "DW_3_d_zr"; }
code_block_96 = CodeBlock { 0; 1; 2; 3; }
getItemAtIndex_131 = List.GetItemAtIndex(list=deconstructPoint_26.Z@L3, index=code_block_96.out0)
setParameterByName_69 = Element.SetParameterByName(element=byPoints_2, parameterName=code_block_95.out0, value=getItemAtIndex_131)
getItemAtIndex_132 = List.GetItemAtIndex(list=deconstructPoint_26.Z@L3, index=code_block_96.out1)
setParameterByName_70 = Element.SetParameterByName(element=byPoints_2, parameterName=code_block_95.out1, value=getItemAtIndex_132)
getItemAtIndex_133 = List.GetItemAtIndex(list=deconstructPoint_26.Z@L3, index=code_block_96.out2)
setParameterByName_71 = Element.SetParameterByName(element=byPoints_2, parameterName=code_block_95.out2, value=getItemAtIndex_133)
getItemAtIndex_134 = List.GetItemAtIndex(list=deconstructPoint_26.Z@L3, index=code_block_96.out3)
setParameterByName_72 = Element.SetParameterByName(element=byPoints_2, parameterName=code_block_95.out3, value=getItemAtIndex_134)
code_block_97 = CodeBlock { "DW_1_z"; "DW_2_z"; "DW_3_z"; }
setParameterByName_73 = Element.SetParameterByName(element=byPoints_2@L3, parameterName=code_block_97.out2, value=maximumItem_6)
setParameterByName_74 = Element.SetParameterByName(element=byPoints_2@L3, parameterName=code_block_97.out1, value=maximumItem_5)
setParameterByName_75 = Element.SetParameterByName(element=byPoints_2@L3, parameterName=code_block_97.out0, value=maximumItem_4)
code_block_98 = CodeBlock { "DW_1_z"; "DW_2_z"; "DW_3_z"; }
setParameterByName_76 = Element.SetParameterByName(element=byPoints@L3, parameterName=code_block_98.out2, value=maximumItem_3)
setParameterByName_77 = Element.SetParameterByName(element=byPoints@L3, parameterName=code_block_98.out1, value=maximumItem_2)
setParameterByName_78 = Element.SetParameterByName(element=byPoints@L3, parameterName=code_block_98.out0, value=maximumItem)
code_block_99 = CodeBlock { [0,1]; }
removeItemAtIndex_9 = List.RemoveItemAtIndex(list=project_6@L3, indices=code_block_99)
code_block_100 = CodeBlock { 32; }
code_block_101 = CodeBlock { 0; }
code_block_102 = CodeBlock { 5; }
mul_3 = medida_de_las_cuchillas_de * code_block_102
code_block_103 = CodeBlock { 1; }
sub = medida_de_las_cuchillas_de - code_block_103
mul_4 = sub * code_block_102
code_block_104 = CodeBlock(a=code_block_101, b=mul_3, c=mul_4, d=mul_2) { a; b; c; d; }
code_block_105 = CodeBlock(a=code_block_101, b=mul_4, c=mul_4, d=mul_2) { a; b; c+b; d; }
