# Dynamo graph Insert_Walls_Civil_V6.dyn (Dynamo 2.4.1.6394)

corridor_name = CodeBlock { "Test_1"; }
current = Autodesk.AutoCAD.DynamoNodes.Document.Current()
corridorByName = Autodesk.Civil.DynamoNodes.Selection.CorridorByName(name=corridor_name, document=current)
baselines = Autodesk.Civil.DynamoNodes.Corridor.Baselines(corridor=corridorByName)
code_futureline_1 = CodeBlock { "Left"; }
corridorFeatureLinesByCode = Autodesk.Civil.DynamoNodes.Baseline.CorridorFeatureLinesByCode(baseline=baselines, code=code_futureline_1)
startStation = Autodesk.Civil.DynamoNodes.CorridorFeatureLine.StartStation(corridorFeatureLine=corridorFeatureLinesByCode)
endStation = Autodesk.Civil.DynamoNodes.CorridorFeatureLine.EndStation(corridorFeatureLine=corridorFeatureLinesByCode)
distance_m = IntegerSlider(5, range=0..500 step 1)

# group: Probar inicio
range = Range(start=startStation, end=endStation, step=distance_m)
start = CodeBlock {  }

coordinateSystemByStation = Autodesk.Civil.DynamoNodes.CorridorFeatureLine.CoordinateSystemByStation(corridorFeatureLine=corridorFeatureLinesByCode, station=range)
ZAxis = CoordinateSystem.ZAxis(coordinateSystem=coordinateSystemByStation)
XAxis = CoordinateSystem.XAxis(coordinateSystem=coordinateSystemByStation)
referenceblock_2 = StringInput("Wall_L")
blockByName = Autodesk.AutoCAD.DynamoNodes.Document.BlockByName(document=current, name=referenceblock_2)  # frozen
baseline_2 = CodeBlock { "Right"; }
corridorFeatureLinesByCode_2 = Autodesk.Civil.DynamoNodes.Baseline.CorridorFeatureLinesByCode(baseline=baselines, code=baseline_2)
startStation_2 = Autodesk.Civil.DynamoNodes.CorridorFeatureLine.StartStation(corridorFeatureLine=corridorFeatureLinesByCode_2)
endStation_2 = Autodesk.Civil.DynamoNodes.CorridorFeatureLine.EndStation(corridorFeatureLine=corridorFeatureLinesByCode_2)
range_2 = Range(start=startStation_2, end=endStation_2, step=distance_m)
coordinateSystemByStation_2 = Autodesk.Civil.DynamoNodes.CorridorFeatureLine.CoordinateSystemByStation(corridorFeatureLine=corridorFeatureLinesByCode_2, station=range_2)
origin = CoordinateSystem.Origin(coordinateSystem=coordinateSystemByStation_2)
byCartesianCoordinates = Point.ByCartesianCoordinates(cs=coordinateSystemByStation_2)
code_block = CodeBlock { 0; }
removeItemAtIndex = List.RemoveItemAtIndex(list=origin@L2, indices=code_block)
flatten = List.Flatten(list=removeItemAtIndex)
flatten_2 = List.Flatten(list=origin)
byTwoPoints = Vector.ByTwoPoints(start=flatten, end=flatten_2)
byStartPointDirectionLength = Line.ByStartPointDirectionLength(startPoint=byCartesianCoordinates, direction=byTwoPoints, length=distance_m)
normal = Curve.Normal(curve=byStartPointDirectionLength)
XAxis_2 = Vector.XAxis()
YAxis = CoordinateSystem.YAxis(coordinateSystem=coordinateSystemByStation_2)
angleAboutAxis = Vector.AngleAboutAxis(vector=XAxis_2, otherVector=YAxis, rotationAxis=normal)
code_block_2 = CodeBlock(a=angleAboutAxis) { a + [-0]; }
string = StringInput("Wall_3D")
modelSpace = Autodesk.AutoCAD.DynamoNodes.Document.ModelSpace(document=current)
create = Autodesk.AutoCAD.DynamoNodes.BlockReference.Create(sourceBlock=blockByName, position=origin, normal=normal, rotationDegrees=code_block_2, layer=string, block=modelSpace)
XAxis_3 = CoordinateSystem.XAxis(coordinateSystem=coordinateSystemByStation_2)
ZAxis_2 = CoordinateSystem.ZAxis(coordinateSystem=coordinateSystemByStation_2)
byTwoPoints_2 = Vector.ByTwoPoints()  # unwired: start, end
referenceblock_1 = StringInput("Wall_R")
blockByName_2 = Autodesk.AutoCAD.DynamoNodes.Document.BlockByName(document=current, name=referenceblock_1)
origin_2 = CoordinateSystem.Origin(coordinateSystem=coordinateSystemByStation)
byCartesianCoordinates_2 = Point.ByCartesianCoordinates(cs=coordinateSystemByStation)
code_block_3 = CodeBlock { 0; }
removeItemAtIndex_2 = List.RemoveItemAtIndex(list=origin_2@L2, indices=code_block_3)
flatten_3 = List.Flatten(list=removeItemAtIndex_2)
flatten_4 = List.Flatten(list=origin_2)
byTwoPoints_3 = Vector.ByTwoPoints(start=flatten_3, end=flatten_4)
byStartPointDirectionLength_2 = Line.ByStartPointDirectionLength(startPoint=byCartesianCoordinates_2, direction=byTwoPoints_3, length=distance_m)
normal_2 = Curve.Normal(curve=byStartPointDirectionLength_2)
XAxis_4 = Vector.XAxis()
YAxis_2 = CoordinateSystem.YAxis(coordinateSystem=coordinateSystemByStation)
angleAboutAxis_2 = Vector.AngleAboutAxis(vector=XAxis_4, otherVector=YAxis_2, rotationAxis=normal_2)
code_block_4 = CodeBlock(a=angleAboutAxis_2) { a + [-0]; }
layer_blockreference = StringInput("Wall_3D")
create_2 = Autodesk.AutoCAD.DynamoNodes.BlockReference.Create(sourceBlock=blockByName_2, position=origin_2, normal=normal_2, rotationDegrees=code_block_4, layer=layer_blockreference, block=modelSpace)
explode = Autodesk.AutoCAD.DynamoNodes.Object.Explode(object=create_2)
geometry = Autodesk.AutoCAD.DynamoNodes.Object.Geometry(object=explode)
flatten_5 = List.Flatten(list=geometry)
flatten_6 = List.Flatten(list=origin_2)
direction = Line.Direction(line=byStartPointDirectionLength_2)
flatten_7 = List.Flatten(list=direction)
XY = Plane.XY()
normal_3 = Plane.Normal(plane=XY)
byStartPointEndPoint = Line.ByStartPointEndPoint(startPoint=byCartesianCoordinates_2, endPoint=byCartesianCoordinates)
direction_2 = Line.Direction(line=byStartPointEndPoint)
angleWithVector = Vector.AngleWithVector(vector=normal_3, otherVector=direction_2)
code_block_5 = CodeBlock { 90; }
sub = angleWithVector - code_block_5
sentido_del_ángulo = CodeBlock { -1; }
mul = sub * sentido_del_ángulo
flatten_8 = List.Flatten(list=mul)
rotate = Geometry.Rotate(geometry=flatten_5, origin=flatten_6, axis=flatten_7, degrees=flatten_8)
layer_final_solid = CodeBlock { "0"; }
byGeometry = Autodesk.AutoCAD.DynamoNodes.Object.ByGeometry(geometry=rotate, layer=layer_final_solid, block=modelSpace)
